# Grasshopper definition plate-design.gh (Grasshopper 1.0.9)

number_slider = Slider(29, range=-70..70)
lamcp = LAMCPBridge(enable=Toggle(True))  # -> status; inputs enable: Boolean, port: Int32
#   port enable: Toggle to start (True) or stop (False) the local HTTP server.
#   port port: Port to listen on (loopback only). Defaults to 8765.
#   port status: Current server status string.
# ---------- lamcp: Python ----------
"""
LAMCP Bridge: local HTTP server inside Rhino 8 / Grasshopper CPython.

Exposes `POST /exec` (JSON: `{"code": "...", "timeout": 30}`) which
exec()s `code` and returns
`{"stdout": "...", "stderr": "...", "result": "...", "error": null|str}`.

Pair with the `lamcp` FastMCP server, which translates Claude's
`run_python_script` MCP tool calls into POSTs to this endpoint.

Binds to 127.0.0.1 only. NEVER expose beyond localhost â€” it exec()s
arbitrary Python with full Rhino API access.

LAMCP v0.1.0
"""

import contextlib
import io
import json
import threading
import traceback
from http.server import BaseHTTPRequestHandler
from http.server import HTTPServer

import Grasshopper
import scriptcontext as sc


SHARED_GLOBALS_KEY = "_lamcp_bridge_globals"
SERVER_KEY = "_lamcp_bridge_server"


def _exec_code(code, timeout):
    """Run `code` on the HTTP-server thread and capture stdout/stderr/result.

    NOTE: this is intentionally NOT marshalled to Rhino's UI thread for the
    spike â€” `Rhino.RhinoApp.InvokeOnUiThread` was queueing actions that
    never fired in Rhino 8 CPython. Most read-only RhinoCommon access is
    safe cross-thread; mutations may crash. Add Eto-based marshalling
    back here when we need it.
    """
    out = io.StringIO()
    err = io.StringIO()
    g = sc.sticky.setdefault(SHARED_GLOBALS_KEY, {"__name__": "__lamcp_bridge__"})
    error_text = None
    result_repr = None
    try:
        with contextlib.redirect_stdout(out), contextlib.redirect_stderr(err):
            exec(code, g, g)
            result_repr = repr(g.get("_"))
    except BaseException:
        error_text = traceback.format_exc()

    return {
        "stdout": out.getvalue(),
        "stderr": err.getvalue(),
        "result": result_repr,
        "error": error_text,
    }


class _ExecHandler(BaseHTTPRequestHandler):
    # Silence default request logging so it doesn't clog the Rhino command line.
    def log_message(self, fmt, *args):
        pass

    def _send(self, code, payload):
        body = json.dumps(payload).encode("utf-8")
        self.send_response(code)
        self.send_header("Content-Type", "application/json")
        self.send_header("Content-Length", str(len(body)))
        self.end_headers()
        self.wfile.write(body)

    def do_GET(self):
        if self.path == "/health":
            self._send(200, {"status": "ok"})
        else:
            self._send(404, {"error": "not found"})

    def do_POST(self):
        if self.path != "/exec":
            self._send(404, {"error": "not found"})
            return
        length = int(self.headers.get("Content-Length", "0"))
        try:
            raw = self.rfile.read(length).decode("utf-8")
            body = json.loads(raw)
            code = body.get("code", "")
            timeout = float(body.get("timeout", 30.0))
        except Exception as exc:
            self._send(400, {"error": "bad request: " + repr(exc)})
            return
        result = _exec_code(code, timeout)
        self._send(200, result)


def _start_server(port):
    server = HTTPServer(("127.0.0.1", port), _ExecHandler)
    thread = threading.Thread(
        target=server.serve_forever, daemon=True, name="lamcp-bridge"
    )
    thread.start()
    return {"server": server, "thread": thread, "port": port}


def _stop_server(state):
    try:
        state["server"].shutdown()
        state["server"].server_close()
    except Exception:
        pass


class LamcpBridgeComponent(Grasshopper.Kernel.GH_ScriptInstance):
    def RunScript(self, enable: bool, port: int):
        port = int(port) if port else 8765

        state = sc.sticky.get(SERVER_KEY)

        if not enable:
            if state is not None:
                _stop_server(state)
                del sc.sticky[SERVER_KEY]
            return "stopped"

        # Already running on the requested port: no-op.
        if (
            state is not None
            and state.get("port") == port
            and state["thread"].is_alive()
        ):
            return "listening on http://127.0.0.1:{}".format(port)

        # Port changed or server died: tear down and restart.
        if state is not None:
            _stop_server(state)
            del sc.sticky[SERVER_KEY]

        try:
            sc.sticky[SERVER_KEY] = _start_server(port)
        except OSError as exc:
            ghenv.Component.AddRuntimeMessage(  # noqa: F821
                Grasshopper.Kernel.GH_RuntimeMessageLevel.Error,
                "Failed to bind 127.0.0.1:{}: {}".format(port, exc),
            )
            return "error: {}".format(exc)

        return "listening on http://127.0.0.1:{}".format(port)
# ---------- end lamcp ----------
enable_reload = EnableReload()  # -> status
#   port status: Output status
# ---------- enable_reload: Python ----------
# r: compas
import Grasshopper
from compas_rhino.devtools import DevTools


class Script_Instance(Grasshopper.Kernel.GH_ScriptInstance):
    def RunScript(self):
        DevTools.enable_reloader()
        return 'COMPAS side-by-side reloader enabled'
# ---------- end enable_reload ----------
vurp_lower_plate_parametric = VURPLowerPlateParametric(
    plate_length=Slider(142, range=10..200),
    plate_width=Slider(78, range=10..200),
    plate_thickness=Slider(8, range=2..10),
    front_wall_height=Slider(32, range=2..50),
    rear_wall_height=Slider(32, range=2..50),
    breadboard_length=Slider(85.5, range=10..200),
    breadboard_width=Slider(56.5, range=10..200),
    breadboard_clearance=Slider(1, range=1..10),
    breadboard_offset_x=Slider(1, range=1..10),
    motor_driver_offset_x=Slider(-56, range=-100..100),
    display_width=Slider(27.3, range=10..200),
    display_height=Slider(28, range=10..200),
    display_active_width=Slider(26, range=10..200),
    display_active_height=Slider(15, range=1..200),
    display_recess_depth=Slider(4.03, range=1..200),
    display_support_thickness=Slider(7.02, range=1..200),
    display_joint_clearance=Slider(0.25, range=0..3),
    upper_hole_x_rear=Slider(-40, range=-70..70),
    upper_hole_x_front=Slider(40, range=-70..70),
    upper_hole_y_offset=Slider(35, range=-70..70),
    chassis_rear_hole_x=Slider(-45.6, range=-70..70),
    chassis_rear_hole_y_offset=number_slider,
    chassis_front_hole_y_offset=number_slider)  # -> body, display_holder, parameters
#   port plate_length: Input plate_length
#   port plate_width: Input plate_width
#   port plate_thickness: Input plate_thickness
#   port front_wall_height: Input front_wall_height
#   port rear_wall_height: Input rear_wall_height
#   port wall_thickness: Input wall_thickness
#   port fillet_radius: Input fillet_radius
#   port breadboard_length: Input breadboard_length
#   port breadboard_width: Input breadboard_width
#   port breadboard_clearance: Input breadboard_clearance
#   port breadboard_offset_x: Input breadboard_offset_x
#   port breadboard_offset_y: Input breadboard_offset_y
#   port motor_driver_offset_x: Input motor_driver_offset_x
#   port motor_driver_recess_depth: Input motor_driver_recess_depth
#   port display_width: Input display_width
#   port display_height: Input display_height
#   port display_depth: Input display_depth
#   port display_active_width: Input display_active_width
#   port display_active_height: Input display_active_height
#   port display_clearance: Input display_clearance
#   port display_tilt_deg: Input display_tilt_deg
#   port display_offset_y: Input display_offset_y
#   port display_recess_depth: Input display_recess_depth
#   port display_support_margin: Input display_support_margin
#   port display_support_thickness: Input display_support_thickness
#   port display_front_overlap: Input display_front_overlap
#   port display_joint_width: Input display_joint_width
#   port display_joint_depth_x: Input display_joint_depth_x
#   port display_joint_insertion_depth: Input display_joint_insertion_depth
#   port display_joint_clearance: Input display_joint_clearance
#   port display_retainer_tab_size: Input display_retainer_tab_size
#   port display_retainer_overlap: Input display_retainer_overlap
#   port display_retainer_thickness: Input display_retainer_thickness
#   port upper_hole_diameter: Input upper_hole_diameter
#   port upper_hole_x_rear: Input upper_hole_x_rear
#   port upper_hole_x_front: Input upper_hole_x_front
#   port upper_hole_y_offset: Input upper_hole_y_offset
#   port chassis_hole_diameter: Input chassis_hole_diameter
#   port chassis_rear_hole_x: Input chassis_rear_hole_x
#   port chassis_rear_hole_y_offset: Input chassis_rear_hole_y_offset
#   port chassis_front_hole_x: Input chassis_front_hole_x
#   port chassis_front_hole_y_offset: Input chassis_front_hole_y_offset
#   port bezel_border: Input bezel_border
#   port bezel_thickness: Input bezel_thickness
#   port display_holder: Output display_holder
# ---------- vurp_lower_plate_parametric: Python ----------
# venv: pyroki
import Grasshopper
from compas_rhino import DevTools
DevTools.ensure_path()
import compas.plugins
import compas_rhino.geometry.brep as rhino_brep_plugins
from compas_rhino.conversions import brep_to_rhino
from compas_rhino.geometry import RhinoBrep
compas.plugins.plugin_manager.register_module(rhino_brep_plugins)
import vurp_geometry

class Script_Instance(Grasshopper.Kernel.GH_ScriptInstance):
    def RunScript(self,
            plate_length,
            plate_width,
            plate_thickness,
            front_wall_height,
            rear_wall_height,
            wall_thickness,
            fillet_radius,
            breadboard_length,
            breadboard_width,
            breadboard_clearance,
            breadboard_offset_x,
            breadboard_offset_y,
            motor_driver_offset_x,
            motor_driver_recess_depth,
            display_width,
            display_height,
            display_depth,
            display_active_width,
            display_active_height,
            display_clearance,
            display_tilt_deg,
            display_offset_y,
            display_recess_depth,
            display_support_margin,
            display_support_thickness,
            display_front_overlap,
            display_joint_width,
            display_joint_depth_x,
            display_joint_insertion_depth,
            display_joint_clearance,
            display_retainer_tab_size,
            display_retainer_overlap,
            display_retainer_thickness,
            upper_hole_diameter,
            upper_hole_x_rear,
            upper_hole_x_front,
            upper_hole_y_offset,
            chassis_hole_diameter,
            chassis_rear_hole_x,
            chassis_rear_hole_y_offset,
            chassis_front_hole_x,
            chassis_front_hole_y_offset,
            bezel_border,
            bezel_thickness):
        core = vurp_geometry.load_core()
        core.set_brep_backend(RhinoBrep)
        p = core.PlateParameters()
        values = {
            "plate_length": plate_length,
            "plate_width": plate_width,
            "plate_thickness": plate_thickness,
            "front_wall_height": front_wall_height,
            "rear_wall_height": rear_wall_height,
            "wall_thickness": wall_thickness,
            "fillet_radius": fillet_radius,
            "breadboard_length": breadboard_length,
            "breadboard_width": breadboard_width,
            "breadboard_clearance": breadboard_clearance,
            "breadboard_offset_x": breadboard_offset_x,
            "breadboard_offset_y": breadboard_offset_y,
            "motor_driver_offset_x": motor_driver_offset_x,
            "motor_driver_recess_depth": motor_driver_recess_depth,
            "display_width": display_width,
            "display_height": display_height,
            "display_depth": display_depth,
            "display_active_width": display_active_width,
            "display_active_height": display_active_height,
            "display_clearance": display_clearance,
            "display_tilt_deg": display_tilt_deg,
            "display_offset_y": display_offset_y,
            "display_recess_depth": display_recess_depth,
            "display_support_margin": display_support_margin,
            "display_support_thickness": display_support_thickness,
            "display_front_overlap": display_front_overlap,
            "display_joint_width": display_joint_width,
            "display_joint_depth_x": display_joint_depth_x,
            "display_joint_insertion_depth": display_joint_insertion_depth,
            "display_joint_clearance": display_joint_clearance,
            "display_retainer_tab_size": display_retainer_tab_size,
            "display_retainer_overlap": display_retainer_overlap,
            "display_retainer_thickness": display_retainer_thickness,
            "upper_hole_diameter": upper_hole_diameter,
            "upper_hole_y_offset": upper_hole_y_offset,
            "chassis_hole_diameter": chassis_hole_diameter,
            "chassis_rear_hole_x": chassis_rear_hole_x,
            "chassis_rear_hole_y_offset": chassis_rear_hole_y_offset,
            "chassis_front_hole_x": chassis_front_hole_x,
            "chassis_front_hole_y_offset": chassis_front_hole_y_offset,
            "bezel_border": bezel_border,
            "bezel_thickness": bezel_thickness,
        }
        for name, value in values.items():
            if value is not None:
                setattr(p, name, value)
        p.upper_hole_x_positions = (
            p.upper_hole_x_positions[0] if upper_hole_x_rear is None else upper_hole_x_rear,
            p.upper_hole_x_positions[1] if upper_hole_x_front is None else upper_hole_x_front,
        )
        result = core.build_vurp_lower_plate(p)
        return brep_to_rhino(result.body), brep_to_rhino(result.display_holder), p
# ---------- end vurp_lower_plate_parametric ----------
